# Grasshopper definition RhinoPlugInV1.gh (Grasshopper 1.0.8)

py3 = Python3Script(x="8 Ramsay Street Haberfield 2045", y=Toggle(True))  # -> out, c, b, a
# ---------- py3: Python ----------
"""
Compliance Copilot - Final Fixed Version

Outputs:
a = lot_curve: Lot boundary curve
b = envelope_crv: Envelope boundary curve (setbacks applied)
c = mass: 3D building volume
d = citations: All applied rules formatted for display
e = lmr_info: LMR area status
f = controls: Development controls summary
"""

import Rhino.Geometry as rg
import math
import json

try:
    from urllib.request import urlopen, Request
except:
    from urllib2 import urlopen, Request

# ---------------------------------------------------------
# RESET OUTPUTS
# ---------------------------------------------------------
a = None  # lot_curve
b = None  # envelope_crv
c = None  # mass
d = ""    # citations
e = ""    # lmr_info
f = ""    # controls

BACKEND = "http://localhost:8000"

# ---------------------------------------------------------
# INPUTS
# ---------------------------------------------------------
address = x if x is not None else ""
run = y if y is not None else False
housing_type = z if z is not None else ""  # Optional: for SEPP overrides

# ---------------------------------------------------------
# API HELPERS
# ---------------------------------------------------------
def post_json(endpoint, payload):
    body = json.dumps(payload).encode("utf-8")
    req = Request(
        BACKEND + endpoint,
        data=body,
        headers={"Content-Type": "application/json"}
    )
    resp = urlopen(req, timeout=30)
    return json.loads(resp.read().decode("utf-8"))

# ---------------------------------------------------------
# GEOJSON TO RHINO CURVE
# ---------------------------------------------------------
def geojson_to_curve(geo, o_lng, o_lat):
    """Convert GeoJSON polygon to Rhino curve at origin."""
    ring = geo["coordinates"][0]
    cos_lat = math.cos(math.radians(o_lat))
    
    pts = []
    for p in ring:
        xx = (p[0] - o_lng) * 111320.0 * cos_lat
        yy = (p[1] - o_lat) * 110540.0
        pts.append(rg.Point3d(xx, yy, 0))
    
    if pts[0] != pts[-1]:
        pts.append(pts[0])
    
    return rg.Polyline(pts).ToNurbsCurve()

# ---------------------------------------------------------
# EXTRACT DEVELOPMENT CONTROLS
# ---------------------------------------------------------
def extract_controls(dev_controls):
    """Extract key parameters from development_controls dict."""
    if not dev_controls:
        return {}
    
    controls = {}
    
    # Density
    density = dev_controls.get("density", {})
    if density.get("fsr"):
        controls["fsr"] = density["fsr"]["value"]
    controls["max_floor_area_sqm"] = density.get("max_floor_area_sqm")
    
    # Height
    height = dev_controls.get("height", {})
    if height.get("max_height"):
        controls["max_height_m"] = height["max_height"]["value"]
    if height.get("max_storeys"):
        controls["max_storeys"] = int(height["max_storeys"]["value"])
    
    # Parking
    parking = dev_controls.get("parking", {})
    if parking.get("min_parking_spaces"):
        controls["min_parking_spaces"] = int(parking["min_parking_spaces"]["value"])
    
    # Landscaping
    landscaping = dev_controls.get("landscaping_open_space", {})
    if landscaping.get("landscaped_area_pct"):
        controls["landscaped_area_pct"] = landscaping["landscaped_area_pct"]["value"]
    if landscaping.get("private_open_space"):
        controls["private_open_space_sqm"] = landscaping["private_open_space"]["value"]
    
    # Site coverage
    if density.get("site_coverage_pct"):
        controls["site_coverage_pct"] = density["site_coverage_pct"]["value"]
    
    # Envelope metrics
    controls["lot_area_sqm"] = dev_controls.get("lot_area_sqm", 0)
    controls["envelope_area_sqm"] = dev_controls.get("buildable_envelope_area_sqm", 0)
    controls["envelope_coverage_pct"] = dev_controls.get("buildable_envelope_coverage_pct", 0)
    
    return controls

# ---------------------------------------------------------
# COMPUTE MAXIMUM BUILDABLE AREA
# ---------------------------------------------------------
def compute_max_buildable_area(lot_area, envelope_area, ctrl):
    """
    Compute maximum buildable footprint considering:
    - Envelope geometry (setbacks)
    - FSR limits
    - Site coverage limits
    - Landscaping requirements
    - Parking requirements
    """
    constraints = []
    
    # 1. Envelope geometry (setbacks already applied)
    constraints.append(("Envelope (setbacks)", envelope_area))
    
    # 2. Site coverage percentage
    if ctrl.get("site_coverage_pct"):
        sc_area = lot_area * ctrl["site_coverage_pct"] / 100.0
        constraints.append(("Site coverage", sc_area))
    
    # 3. FSR limit (total floor area / storeys = max footprint per floor)
    if ctrl.get("fsr") and ctrl.get("max_storeys"):
        fsr_footprint = (lot_area * ctrl["fsr"]) / ctrl["max_storeys"]
        constraints.append(("FSR limit", fsr_footprint))
    
    # 4. Reserve area for landscaping + parking + private open space
    reserved_area = 0
    
    if ctrl.get("landscaped_area_pct"):
        reserved_area += lot_area * ctrl["landscaped_area_pct"] / 100.0
    
    if ctrl.get("private_open_space_sqm"):
        reserved_area += ctrl["private_open_space_sqm"]
    
    if ctrl.get("min_parking_spaces"):
        # Assume 15 sqm per parking space (typical dimension)
        reserved_area += ctrl["min_parking_spaces"] * 15.0
    
    available_area = max(1, lot_area - reserved_area)
    constraints.append(("Lot minus reserves", available_area))
    
    # Return the most restrictive constraint
    min_constraint = min(constraints, key=lambda x: x[1])
    return min_constraint

# ---------------------------------------------------------
# FORMAT OUTPUT STRINGS
# ---------------------------------------------------------
def format_citations(rules_applied):
    """Format rules for terminal display."""
    if not rules_applied:
        return "No rules applied"
    
    output = []
    output.append("=" * 60)
    output.append("APPLIED RULES")
    output.append("=" * 60)
    
    # Group by source type
    by_source = {}
    for r in rules_applied:
        src = r.get("source_type", "unknown")
        by_source.setdefault(src, []).append(r)
    
    for src_type in sorted(by_source.keys()):
        rules = by_source[src_type]
        output.append("\n[{0}] ({1} rules)".format(src_type.upper(), len(rules)))
        output.append("-" * 60)
        
        for r in rules:
            param = r["parameter"]
            val = r["value"]
            unit = r.get("unit", "")
            clause = r.get("clause", "")
            
            output.append("  {0:30s} : {1}{2:5s} ({3})".format(param, val, unit, clause))
    
    return "\n".join(output)

def format_lmr_info(lmr_data):
    """Format LMR status for terminal display."""
    if not lmr_data:
        return "LMR: Not checked"
    
    status = lmr_data.get("status")
    
    output = []
    output.append("=" * 60)
    output.append("LMR AREA STATUS")
    output.append("=" * 60)
    
    if not status:
        output.append("NOT in Low-Rise Medium Density Housing area")
    elif status == "inner":
        output.append("INNER LMR area (within 400m of station)")
        output.append("  SEPP housing types available with concessions")
    elif status == "outer":
        output.append("OUTER LMR area (400m-800m from station)")
        output.append("  SEPP housing types available with concessions")
    
    if lmr_data.get("nearest_station"):
        output.append("\nNearest station: {0}".format(lmr_data["nearest_station"]))
        output.append("Distance: {0:.0f}m".format(lmr_data.get("distance_m", 0)))
    
    return "\n".join(output)

def format_controls(ctrl, constraint_name, constraint_area, actual_footprint, actual_height, actual_volume):
    """Format development controls for terminal display."""
    if not ctrl:
        return "No development controls"
    
    output = []
    output.append("=" * 60)
    output.append("DEVELOPMENT CONTROLS")
    output.append("=" * 60)
    
    output.append("\nLot area       : {0:.1f} sqm".format(ctrl.get("lot_area_sqm", 0)))
    output.append("Envelope area  : {0:.1f} sqm ({1:.1f}%)".format(
        ctrl.get("envelope_area_sqm", 0),
        ctrl.get("envelope_coverage_pct", 0)
    ))
    
    if ctrl.get("fsr"):
        output.append("\nFSR            : {0}".format(ctrl["fsr"]))
    if ctrl.get("max_floor_area_sqm"):
        output.append("Max floor area : {0:.1f} sqm".format(ctrl["max_floor_area_sqm"]))
    
    if ctrl.get("max_height_m"):
        output.append("\nMax height     : {0} m".format(ctrl["max_height_m"]))
    if ctrl.get("max_storeys"):
        output.append("Max storeys    : {0}".format(ctrl["max_storeys"]))
    
    if ctrl.get("site_coverage_pct"):
        output.append("\nSite coverage  : {0}%".format(ctrl["site_coverage_pct"]))
    
    if ctrl.get("landscaped_area_pct"):
        output.append("\nLandscaping    : {0}%".format(ctrl["landscaped_area_pct"]))
    if ctrl.get("private_open_space_sqm"):
        output.append("Private open   : {0} sqm".format(ctrl["private_open_space_sqm"]))
    
    if ctrl.get("min_parking_spaces"):
        output.append("\nMin parking    : {0} spaces".format(ctrl["min_parking_spaces"]))
    
    output.append("\n" + "-" * 60)
    output.append("BUILDABLE VOLUME (AS MODELED)")
    output.append("-" * 60)
    output.append("Limiting factor: {0}".format(constraint_name))
    output.append("Target footprint: {0:.1f} sqm".format(constraint_area))
    output.append("\nActual footprint: {0:.1f} sqm".format(actual_footprint))
    output.append("Actual height   : {0:.1f} m".format(actual_height))
    output.append("Actual volume   : {0:.1f} m3".format(actual_volume))
    
    return "\n".join(output)

# ---------------------------------------------------------
# MAIN EXECUTION
# ---------------------------------------------------------
if not run:
    d = "Toggle 'run' to True to execute"

elif not address:
    d = "Enter an address"

else:
    try:
        print("\n" + "=" * 60)
        print("ANALYZING: {0}".format(address))
        print("=" * 60)
        
        # Build request payload
        payload = {"address": address}
        if housing_type:
            payload["housing_type"] = housing_type
            print("Housing type: {0}".format(housing_type))
        
        # Call API
        data = post_json("/envelope", payload)
        
        # Extract geometries
        lot_geo = data["lot_polygon"]
        env_geo = data["envelope"]
        
        # Get reference point for coordinate conversion
        ring = lot_geo["coordinates"][0]
        o_lng = sum(p[0] for p in ring) / len(ring)
        o_lat = sum(p[1] for p in ring) / len(ring)
        
        # OUTPUT a: Lot boundary curve
        a = geojson_to_curve(lot_geo, o_lng, o_lat)
        
        # OUTPUT b: Envelope boundary curve
        b = geojson_to_curve(env_geo, o_lng, o_lat)
        
        # Extract development controls
        dev_controls = data.get("development_controls")
        ctrl = extract_controls(dev_controls)
        
        lot_area = ctrl.get("lot_area_sqm", 0)
        envelope_area = ctrl.get("envelope_area_sqm", 0)
        
        # Compute maximum buildable footprint
        constraint_name, max_footprint = compute_max_buildable_area(lot_area, envelope_area, ctrl)
        
        # Create base surface from envelope
        breps = rg.Brep.CreatePlanarBreps(b)
        
        if breps and len(breps) > 0:
            base_surface = breps[0]
            
            # Measure ACTUAL area of the planar surface
            actual_envelope_area = rg.AreaMassProperties.Compute(base_surface).Area
            
            # Get base height from rules
            height_base = ctrl.get("max_height_m", 8.5)
            
            # Calculate effective height to achieve target buildable volume
            # Target volume = max_footprint * height_base
            # Actual volume with envelope = actual_envelope_area * effective_height
            # So: effective_height = (max_footprint * height_base) / actual_envelope_area
            
            target_volume = max_footprint * height_base
            effective_height = target_volume / actual_envelope_area if actual_envelope_area > 0 else height_base
            
            # DEBUG OUTPUT
            print("\n" + "=" * 60)
            print("DEBUG - VOLUME-BASED HEIGHT ADJUSTMENT")
            print("=" * 60)
            print("  Base height (from rules): {0:.1f} m".format(height_base))
            print("  Reported envelope area: {0:.1f} sqm".format(envelope_area))
            print("  Actual envelope area: {0:.1f} sqm".format(actual_envelope_area))
            print("  Max footprint allowed: {0:.1f} sqm".format(max_footprint))
            print("  Target volume: {0:.1f} m3".format(target_volume))
            print("  Effective height: {0:.2f} m".format(effective_height))
            print("  Expected volume: {0:.1f} m3".format(actual_envelope_area * effective_height))
            print("=" * 60)
            
            # OUTPUT c: Create 3D mass using simple extrusion
            extrusion_vector = rg.Vector3d(0, 0, effective_height)
            extruded_surface = rg.Surface.CreateExtrusion(b, extrusion_vector)
            
            if extruded_surface:
                c = extruded_surface.ToBrep()
                # Cap both ends
                c = rg.Brep.CapPlanarHoles(c, 0.01)
            
            # Verify actual volume
            actual_volume = 0
            if c:
                vol_props = rg.VolumeMassProperties.Compute(c)
                if vol_props:
                    actual_volume = vol_props.Volume
                    print("\nVERIFICATION:")
                    print("  Actual volume: {0:.1f} m3".format(actual_volume))
                    print("  Target volume: {0:.1f} m3".format(target_volume))
                    diff_pct = abs(actual_volume - target_volume) / target_volume * 100 if target_volume > 0 else 0
                    print("  Difference: {0:.1f} m3 ({1:.1f}%)".format(
                        abs(actual_volume - target_volume),
                        diff_pct
                    ))
            
            # OUTPUT d: Format citations
            d = format_citations(data.get("rules_applied", []))
            
            # OUTPUT e: Format LMR info
            e = format_lmr_info(data.get("lmr_info"))
            
            # OUTPUT f: Format controls
            f = format_controls(ctrl, constraint_name, max_footprint, actual_envelope_area, effective_height, actual_volume)
            
            # Print to Grasshopper console
            print("\n" + d)
            print("\n" + e)
            print("\n" + f)
            print("\n" + "=" * 60)
            print("GEOMETRY CREATED SUCCESSFULLY")
            print("=" * 60)
        
        else:
            d = "ERROR: Could not create surface from envelope"
            print(d)
    
    except Exception as ex:
        import traceback
        tb = traceback.format_exc()
        d = "ERROR:\n" + tb
        print(tb)
# ---------- end py3 ----------
panel = Panel(py3.out)
